# Grasshopper definition Robotic Wall.gh (Grasshopper 1.0.8)

# ---- group: Brick Dimensions
number_slider = Slider(32, range=0..100)
number_slider_2 = Slider(15.2, range=0..100)
number_slider_3 = Slider(9.85, range=0..100)

# ----
resolution_grid = Slider(2, range=0..10)
base_space_curve = Python3Script(
    x_bound=Slider(420, range=0..1000),
    y_bound=Slider(297, range=0..1000),
    offset_x=Slider(25, range=0..1000),
    offset_y=Slider(25, range=0..1000),
    division=Slider(150, range=0..1000))  # -> out, dwg_midpt, base, basecrv, crvpts, crvlines; inputs x_bound: Double, y_bound: Double, offset_x: Double, offset_y: Double, division: Int32
# ---------- base_space_curve: Python ----------
import Rhino.Geometry as rg

length = x_bound - 2*offset_x
height = y_bound - 2*offset_y
basept = rg.Point3d(offset_x, offset_y, 0.0)
base = rg.Rectangle3d(rg.Plane(basept,rg.Vector3d.ZAxis),length,height)
base = base.ToNurbsCurve()

# 2. Drawing the Base Curve
dwg_midpt = rg.Point3d(x_bound/2, y_bound/2, 0.0)
basecrv = rg.Ellipse(
    rg.Plane(dwg_midpt,rg.Vector3d.ZAxis), 
    (length - 2*offset_x)/2, 
    (height - 2*offset_y)/2
    )
basecrv = basecrv.ToNurbsCurve()

# 3. Drawing the individual lines and points
basecrv.Domain = rg.Interval(0.0,1.0)
crvpts = [basecrv.PointAt(n/division) for n in range(division)]
ts = [n/division for n in range(division)]
print(ts)
print(type((crvpts[0])))
crvlines = [rg.Line(crvpts[i%division], crvpts[(i+1)%division]) for i, p in enumerate(crvpts)]
# ---------- end base_space_curve ----------
series = Series(Start=0, Step=1, Count=Slider(3, range=0..10))
crv = Curve(base_space_curve.base)
boundary = BoundarySurfaces(Edges=base_space_curve.base)
dim = Dimensions(Surface=boundary)  # -> UDimension, VDimension
integer_division = IntegerDivision(A=dim.UDimension, B=resolution_grid)
integer_division_2 = IntegerDivision(A=dim.UDimension, B=resolution_grid)
line = Line(base_space_curve.crvlines)

# ---- group: Restricts Length of the Curve
resolution_guide_curve = Slider(18, range=0..20)
length_line = LengthLine(Line=line, Strength=Slider(100, range=0..100))

# ---- group: Ensures that there is a distance between points
repelling_radii = Slider(25, range=0..50)
index = ItemIndex(List=line, Item=line)
line_2 = Line(line)
shift = ShiftList(List=index, Shift=series, Wrap=True)  # -> simplify(List)
collider = Collider(Objects=line_2, Radii=repelling_radii, IgnoreA=index, IgnoreB=shift, Strength=Slider(10, range=0..100))

# ---- group: Angle Restriction for Curve
shift_2 = ShiftList(List=line_2, Shift=1, Wrap=True)
angle = Angle(LineA=line_2, LineB=shift_2, RestAngle=Slider(2, range=0..100), Strength=Slider(1000, range=0..1000))

# ----
mesh_uv = MeshSurface(Surface=boundary, UCount=integer_division, VCount=integer_division_2, Overhang=True, Equalize=False)
demesh = DeconstructMesh(Mesh=mesh_uv)  # -> Vertices, Faces, Colours, Normals
onmesh = OnMesh(Points=base_space_curve.crvpts, Mesh=mesh_uv, Strength=Slider(100, range=0..100000))
merge = Merge(Data1=onmesh, Data2=length_line, Data3=collider, Data4=angle)  # -> flatten(Result)
bouncysolver = BouncySolver(
    GoalObjects=flatten(merge),
    Reset=Button(),
    Threshold=1e-15,
    Tolerance=0.0001,
    Damping=Slider(0.084, range=0..1),
    Iterations=10,
    On=Toggle(True))  # -> I, V, O
zombiesolver = ZombieSolver(GoalObjects=flatten(merge), Threshold=1e-10, Tolerance=0.0001, MaxIterations=50000)  # -> I, V, O; disabled
dam = DataDam(DataA=bouncysolver.V, BufferDelay=10000000, BufferMode=0)
brick_paths = Python3Script(
    pts=dam,
    work_pt=base_space_curve.dwg_midpt,
    gap=Slider(5, range=0..10),
    no_layers=Slider(12, range=0..100),
    freq=Slider(9, range=0..10),
    deg=Slider(10, range=0..100))  # -> out, tree_pts, frames, profiles; inputs pts: list of Point3d, work_pt: Point3d, no_layers: Int32, freq: Int32, deg: Int32
# ---------- brick_paths: Python ----------
from compas_rhino.devtools import DevTools
DevTools.ensure_path()

# 0. Import everything we will need
import math as m
import ghpythonlib.treehelpers as th
import Rhino.Geometry as rg
from compas_rhino.conversions import point_to_compas, curve_to_compas
from compas.geometry import Curve, NurbsCurve
from compas_rhino.geometry import RhinoNurbsCurve
from compas.geometry import Box
from compas.geometry import Transformation, Translation, Rotation
from compas.geometry import Point, Vector
from compas.geometry import Frame
from brick_wall import Brick

# 0. Provide contextual definitions and set up essential variables
def remap(t, omin, omax, nmin, nmax):
    return (t-omin)/(omax-omin)*(nmax-nmin)+nmin

workspace_pt = point_to_compas(work_pt)

pts = [point_to_compas(pt) for pt in pts]
profile = RhinoNurbsCurve.from_points(pts, degree=deg, is_periodic=True)
result = [profile.closest_point(p, True) for p in pts]
cp, ct = list(zip(*result))

# 1.
# a) Identify how far each point on curve is from the centre 
d_v = [Vector.from_start_end(p, workspace_pt) for p in cp]
l_v = [dv.length for dv in d_v]
for ddv in d_v:
    ddv.unitize()
# b) Generate essential tangent/normal vectors
t_v = [profile.tangent_at(t) for t in ct]
n_v = Vector.cross_vectors([Vector.Zaxis() for t in ct], t_v)
for n in n_v:
    n.unitize()
# c) Map vector values to possible offsets in subsequent curves
c_v = Vector.cross_vectors(t_v, d_v)
m_v = [mg.length for mg in c_v]
mg_v = [remap(m, min(m_v), max(m_v), 1, 2* Brick.WIDTH) for m in m_v]
# d) Assign signs to the remapped values
s_v = [c.z / abs(c.z) if c.z != 0 else 1.0 for c in c_v]
amp_v = [s*m for (s,m) in zip(s_v,mg_v)]

# f_v = [Frame(p, t, n) for (p, t, n) in zip(cp, t_v, n_v)]
# frames = f_v

tree_pts = []


for r in range(no_layers):
    copypts = [p.copy() for p in cp]
    theta = r/(no_layers-1)*2*m.pi
    f_v = [amp*m.sin(freq*theta) for amp in amp_v]
    m_v = [n*fv for (n,fv) in zip(n_v, f_v)]
    transf = [Translation.from_vector(v) for v in m_v]
    for p, pp in enumerate(copypts):
        pp.transform(transf[p])
        pp.z = r*Brick.HEIGHT
    # prf = RhinoNurbsCurve.from_points(copypts, degree = deg, is_periodic = True)        
    tree_pts.append(copypts)


profiles = [RhinoNurbsCurve.from_points(p, degree=deg, is_periodic=True) for p in tree_pts]
profiles = th.list_to_tree(profiles)
# ---------- end brick_paths ----------
nurbs = NurbsCurve(Vertices=zombiesolver.V, Degree=3, Periodic=False)  # -> Curve, Length, Domain; disabled
gap = Slider(7.9, range=0..10)
draw = COMPASDraw(cg=brick_paths.profiles)  # -> rg
#   port cg: The COMPAS geometry or datastructure to be drawn.
#   port rg: The Rhino geometry object.
# ---------- draw: Python ----------
# r: compas>=2.14.1
"""
Draws COMPAS geometry in Grasshopper.
"""

from typing import Any

import Grasshopper

from compas.scene import SceneObject


class CompasToRhinoGeometry(Grasshopper.Kernel.GH_ScriptInstance):
    def RunScript(self, cg):
        if not cg:
            return None

        return SceneObject(item=cg).draw()
# ---------- end draw ----------
crv_2 = Curve(reparameterize(draw))
brick_wall = Python3Script(crv=crv_2, max_ang=Slider(30, range=0..100), gap=gap, mid_pt=base_space_curve.dwg_midpt)  # -> bricks, geometries, frames; inputs crv: list of Curve, max_ang: Double, gap: Double, mid_pt: Point3d
# ---------- brick_wall: Python ----------
# r: compas
# venv: mas-2627
from compas_rhino.devtools import DevTools
DevTools.ensure_path()

# 0. Import everything we will need
import math as m
from compas_rhino.conversions import point_to_compas,curve_to_compas
import ghpythonlib.treehelpers as th
from compas.geometry import Curve, Box, Circle, Polygon
from compas.geometry import Point, Vector
from compas.geometry import Frame

# ..also import our module "brick_wall.py", that needs to be in the same folder as our GH file
from brick_wall import Brick

# 0. Provide contextual definitions and set up essential variables
def remap(t, omin, omax, nmin, nmax):
    return (t-omin)/(omax-omin)*(nmax-nmin)+nmin

# def true_dist(brick, rotation):

mid_pt = point_to_compas(mid_pt)
bricks, frames = [], []
crvs = [curve_to_compas(c) for c in crv]

rect = Polygon.from_rectangle(Point(0.0,0.0,0.0), Brick.LENGTH, Brick.WIDTH)


for nc, c in enumerate(crvs):
    t = 0
    p0 = c.point_at(0)
    t0 = c.tangent_at(0)
    n0 = Vector.cross(Vector.Zaxis(), t0)
    f = [Frame(p0, t0, n0)]

    d0 = Vector.from_start_end(p0, mid_pt)
    c0 = Vector.cross(t0, d0)
    c0.unitize()
    m0 = c0.z
    mg0 = m0/abs(m0) * remap(1.0 - abs(m0), 0.0, 1.0, 0.0, max_ang)
# ---------- end brick_wall ----------
draw_2 = COMPASDraw(cg=brick_wall.bricks)  # -> rg; same code as draw
